# Grasshopper definition GH_Robot_ForwardKinematic.gh (Grasshopper 1.0.7)
# plug-ins: Robots

# LOY'S OPEN-SOURCE - GH DEFINITION
# USER INPUTS
# Package(s) Needed: Robot (https://www.food4rhino.com/en/app/robots)
robotbase_float = Slider(0, range=-180..180)
# READ ME
robotshoulder_float = Slider(-90, range=-180..180)
robotelbow_float = Slider(90, range=-85..225)
# Note(s): 1. Make sure the Rhino project is in "mm".
# 3. Connect to the same network as the robots.
wristpitch_float = Slider(-90, range=-180..180)
wristyaw_float = Slider(-90, range=-180..180)
# Tested In: 240717_In Rhino 7_weiwin.loy@hdr.qut.edu.au.
# User Note: This is similar to defjoints in Robot.Extend (additional plugin)
wristroll_float = Slider(0, range=-270..270)
# AUTOMATIC INPUTS
python = GhPythonScript(
    RobotBase_Float=robotbase_float,
    RobotShoulder_Float=robotshoulder_float,
    RobotElbow_Float=robotelbow_float,
    WristPitch_Float=wristpitch_float,
    WristYaw_Float=wristyaw_float,
    WristRoll_Float=wristroll_float)  # -> out, RobotJointinRadians
# ---------- python: Python ----------
import math

def convert_to_radians_and_format(RobotBase_Float, RobotShoulder_Float, RobotElbow_Float, WristPitch_Float, WristYaw_Float, WristRoll_Float):
    # Input values from Grasshopper sliders
    values = [RobotBase_Float, RobotShoulder_Float, RobotElbow_Float, WristPitch_Float, WristYaw_Float, WristRoll_Float]
    
    # Convert each value to radians
    radians = [math.radians(value) for value in values]
    
    # Format the values as a comma-separated string
    formatted_string = ", ".join("{:.6f}".format(rad) for rad in radians)
    
    return formatted_string

# Get the values from the inputs
formatted_string = convert_to_radians_and_format(RobotBase_Float, RobotShoulder_Float, RobotElbow_Float, WristPitch_Float, WristYaw_Float, WristRoll_Float)

# Output the formatted string
RobotJointinRadians = formatted_string  # 'RobotJointinRadians' is the default output in Grasshopper Python component
# ---------- end python ----------
target = CreateTarget(Joints=python.RobotJointinRadians, IsCartesian=False)
# HELPERS
panel = Panel(python.out)
# PROCESSING FUNCTIONS
# MAIN FUNCTION
# UI / OUTPUTS
panel_2 = Panel(target)
