# Grasshopper definition GH_Anemone_TimerForRobotSimulation.gh (Grasshopper 1.0.7)
# plug-ins: Anemone, Robots

# ----
# Package(s) Needed: Robot plugin.
# Anemone plugin.
# READ ME
# Note(s): 1. Make sure the Rhino project is in "mm".
# Tested In: 230624_In Rhino 7_loyweiwin@gmail.com
# Updates and Changes: 1. Create a button trigger timer using Anenome
input_maxrange = Slider(243, range=0..1000)
input_robotmotion = Button()

# ---- group: ATTACHED YOUR PROGRAM HERE
input_robotprogram = ProgramParameter()

# ----
# 02
input_increaseby = Data(1)
input_trigger = Data(input_robotmotion)
# LOY'S OPEN SOURCE
# USER INPUTS
# AUTOMATIC INPUTS
# 01
input_maxrange_2 = Data(input_maxrange)

# ---- group: GH | Loop Anemone
# Timer & Motion Mode
input_maxrange_3 = Data(input_maxrange_2)
input_trigger_2 = Data(input_trigger)
input_increaseby_2 = Data(input_increaseby)

# ----
# AUTOMATIC INPUTS
loop_start = LoopStart(Repeat=input_maxrange_3, Trigger=input_trigger_2, Data=0)  # -> port, Counter, Data

# ---- group: GH | Loop Anemone (continued)
larger = LargerThan(FirstNumber=loop_start.Data, SecondNumber=input_maxrange_3)  # -> LargerThan, OrEqualTo
addition = Addition(A=loop_start.Data, B=input_increaseby_2)
# HELPERS
loop_end = LoopEnd(port=loop_start.port, Exit=larger.OrEqualTo, Data=addition, TimeOutVal=0, pausedState=False, state="Constant output")

# ----
input_maxrange_4 = Data(input_maxrange_2)
input_increaseby_3 = Data(input_increaseby)
# PROCESSING FUNCTIONS
subtraction = Subtraction(A=loop_end, B=input_increaseby_3)
division = Division(A=subtraction, B=input_maxrange_4)

# ----
# MAIN FUNCTION
# UI / OUTPUTS
output_from_0_to_1 = Panel(division)
output_time_from_0_to_1 = Data(division)

input_time_from_0_to_1 = Data(output_time_from_0_to_1)

# ----
# Robot Simulation
program_simulation = ProgramSimulation(Program=input_robotprogram, Time=input_time_from_0_to_1, Normalized=True)  # -> SystemMeshes, JointRotations, Plane, Index, Time, Program, Errors
output_mesh = Data(program_simulation.SystemMeshes)
