# Grasshopper definition GH_Generation_RobotSimulation.gh (Grasshopper 1.0.7)
# Copyright: GNU V3
# plug-ins: G E N E R A T I O N, Robots

# ----
# Package(s) Needed: Robot (https://www.food4rhino.com/en/app/robots)
# Generation (https://www.food4rhino.com/en/app/generation)
# READ ME
# Note(s): 1. Make sure the Rhino project is in "mm".
# 3. Connect to the same network as the robots.
# Tested In: 240717_In Rhino 7_weiwin.loy@hdr.qut.edu.au.
input_pause = Button()
input_reset = Button()
input_pause_2 = Data(input_pause)
input_reset_2 = Data(input_reset)

# ----
# LOY'S OPEN-SOURCE - GH DEFINITION
# USER INPUTS
trigger = Trigger(Interval=100, TimerInterval=100, Target=count)

input_pause_3 = Data(input_pause_2)
input_reset_3 = Data(input_reset_2)

# ----
# AUTOMATIC INPUTS
count = Counter(Start=0, Step=0.1, Pause=input_pause_3, Reset=input_reset_3)
# HELPERS
# PROCESSING FUNCTIONS
# MAIN FUNCTION
# UI / OUTPUTS
output_countertime = Data(count)

output_countertime_2 = Data(output_countertime)

input_robotprogram = ProgramParameter()

input_robotprogram_2 = ProgramParameter(input_robotprogram)

cluster = Cluster(program=input_robotprogram_2)
output_time = Data(cluster)

output_robottime = Data(output_time)

division = Division(A=output_countertime_2, B=output_robottime)
sim = ProgramSimulation(Program=input_robotprogram, Time=division, Normalized=True)  # -> SystemMeshes, JointRotations, Plane, Index, Time, Program, Errors
visualiserobotpath_pose = VIsualiseRobotPathPose(G=sim.SystemMeshes, L=sim.Plane, P=sim.Program)

# ==== cluster Cluster
program = ClusterInput()
program_2 = ProgramParameter(program)
sim = ProgramSimulation(Program=program_2, Time=1, Normalized=True)  # -> SystemMeshes, JointRotations, Plane, Index, Time, Program, Errors
output_time = Data(sim.Time)
output_time_2 = ClusterOutput(output_time)

# ==== cluster VIsualiseRobotPathPose: VIsualiseRobotPath&Pose
L = ClusterInput()
P = ClusterInput()
item = ListItem(List=L, Index=-1, Wrap=True)
swatch = ColourSwatch(SwatchColor=RGBA(255, 255, 255, 104))
G = ClusterInput()
trail = SimpleTrail(Program=P, Length=1000000, MechanicalGroup=0)
msphere = MeshSphere(Base=item, Radius=10, UCount=10, VCount=20)
preview = CustomPreview(Geometry=G, Material=swatch)
preview_2 = CustomPreview(Geometry=trail, Material=swatch)
preview_3 = CustomPreview(Geometry=msphere, Material=swatch)
